# Grasshopper definition E01_0.2.0_SimplePoint&Box.gh (Grasshopper 0.9.76)
# plug-ins: Embryo

# The component types that are used are placed here. More of the same type increases the likelyhood of selection (such as with the points here).
# You can enable/disable to include/exclude in your graph generation
pt = ConstructPoint(XCoordinate=0, YCoordinate=0, ZCoordinate=0)
box = Box2Pt(Plane=PlaneXY(0, 0, 0))

# ----
# Set to True
toggle = BooleanToggle(False)

# ----
# Sliders & Component numbers
sliders = Slider(6, range=0..100)
components = Slider(15, range=0..100)

# ----
# Change Random Seed to Explore
random_seed = Slider(33, range=0..100)

# ----
# E01. Introduction
# 
# Embryo uses 3 of the 4 quadrants on the canvas.
# 
# The 'Parent' definition is located in the usual quadrant on the canvas and contains the Embryo main component.
# 
# The 'Child' generated network is in the top-right quadrant.
# The 'Ingredients' that are used (the components) by Embryo when the new graph is formed are located in the bottom-left quadrant.
g_slider5 = Slider(2.791, range=-10..10)
g_slider4 = Slider(-3.629, range=-10..10)
g_slider3 = Slider(-1.15, range=-10..10)
g_slider2 = Slider(3.838, range=-10..10)
g_slider1 = Slider(2.036, range=-10..10)
g_slider0 = Slider(9.326, range=-10..10)
embryo = EmbryoSettings(
    Preview=True,
    SliderDomain=Domain(-10, 10),
    OneToOne=False,
    GridX=120,
    GridY=120,
    RemoveDead=Toggle(True),
    OnlyTerminals=False)
# This is the main Embryo component that generates the new definitions.
# 
# Embryo has two separate (at present random) seeds for generating the parameters and the graph components/topology. In this example they are both controlled by one slider
embryo_2 = Embryo(
    Reset=toggle,
    Sliders=sliders,
    Components=components,
    MetricGenes=2,
    TopologyGenes=2,
    FunctionGenes=2,
    Settings=embryo,
    RandomOveride=random_seed)  # -> Iterations, Components
g_pt = ConstructPoint(XCoordinate=g_slider3, YCoordinate=g_slider4, ZCoordinate=g_slider2)
g_pt_2 = ConstructPoint(XCoordinate=g_slider1, YCoordinate=g_slider4, ZCoordinate=g_slider3)
g_pt_3 = ConstructPoint(XCoordinate=g_slider3, YCoordinate=g_slider4, ZCoordinate=g_slider1)
g_pt_4 = ConstructPoint(XCoordinate=g_slider5, YCoordinate=g_slider0, ZCoordinate=g_slider3)
g_pt_5 = ConstructPoint(XCoordinate=g_slider4, YCoordinate=g_slider5, ZCoordinate=g_slider2)
g_pt_6 = ConstructPoint(XCoordinate=g_slider1, YCoordinate=g_slider2, ZCoordinate=g_slider5)
g_pt_7 = ConstructPoint(XCoordinate=g_slider3, YCoordinate=g_slider1, ZCoordinate=g_slider0)
g_box = Box2Pt(PointA=g_pt_5, PointB=g_pt_2, Plane=PlaneXY(0, 0, 0))
g_box_2 = Box2Pt(PointA=g_pt_7, PointB=g_pt_4, Plane=PlaneXY(0, 0, 0))
g_box_3 = Box2Pt(PointA=g_pt_5, PointB=g_pt_6, Plane=PlaneXY(0, 0, 0))
g_box_4 = Box2Pt(PointA=g_pt_6, PointB=g_pt_5, Plane=PlaneXY(0, 0, 0))
g_box_5 = Box2Pt(PointA=g_pt_5, PointB=g_pt_7, Plane=PlaneXY(0, 0, 0))
g_box_6 = Box2Pt(PointA=g_pt_5, PointB=g_pt_4, Plane=PlaneXY(0, 0, 0))
# The generated graph is sorted in terms of dependency.
# 
# The parameters always have rank 0 and therefore are located on the far left hand side.
# 
# In a technical sense, the directed acyclic graph (DAG) that is generated is topologically sorted to show a dependency structure.
g_box_7 = Box2Pt(PointA=g_pt_7, PointB=g_pt_6, Plane=PlaneXY(0, 0, 0))
g_box_8 = Box2Pt(PointA=g_pt_7, PointB=g_pt_6, Plane=PlaneXY(0, 0, 0))
