# Grasshopper definition E02_0.2.0_PointsLinesDivide.gh (Grasshopper 0.9.75)
# plug-ins: Embryo

# E02.
# 
# In this example the form generated is slightly more complex than E01 due to the inclusion of a divide component.
# 
# The settings component is also introduced.
divide = DivideCurve(Count=10, Kinks=False)  # -> Points, Tangents, Parameters
box = Box2Pt(Plane=PlaneXY(0, 0, 0))
pt = ConstructPoint(XCoordinate=0, YCoordinate=0, ZCoordinate=0)
ln = Line()
number_slider = Slider(63, range=0..100)

# ----
# Setting RemoveDead to True will remove any components that have either a warning or error flag (note: this is just a visibility toggle, such compoents will never be connected to once they are not clean).
# The settings component contains extra user preferences such as whether a preview is displayed, the parameter domains, grid size, etc...
toggle = BooleanToggle(True)
embryo = EmbryoSettings(Preview=True, SliderDomain=Domain(-10, 10), OneToOne=False, GridX=120, GridY=120, RemoveDead=toggle, OnlyTerminals=False)

embryo_2 = Embryo(
    Reset=Toggle(False),
    Sliders=number_slider,
    Components=number_slider,
    MetricGenes=2,
    TopologyGenes=2,
    FunctionGenes=2,
    Settings=embryo,
    RandomOveride=Slider(53, range=0..100))  # -> Iterations, Components
