# Grasshopper definition example-003-galapagos.gh (Grasshopper 0.9.76)
# plug-ins: Embryo

addition = Addition()
# In this example, we use Embryo to solve a combinatorial numbers problem.
# 
# Double-click on the galapagos component to start, making sure to minimise the problem not maximise!
# 
# The genome for the optimisation is the random topology input. The fitness is the absolute distance from the target result (314).
# 
# As currently the topology seed is random, it is only solved by brute-force in this example.
# 
# For more complex problems, we can use a gene pool for each numeric, functional and topological aspects of Embryo
# 
# Note the use of the One-to-One setting.
addition_2 = Addition()
addition_3 = Addition()
subtraction = Subtraction()
multiplication = Multiplication()

# ---- group: Input numbers
# Set to True
slider = Slider(50, range=0..50)
parent_output = ParentOutput(O=[Slider(4, range=0..4), Slider(5, range=0..5), Slider(6, range=0..6), Slider(7, range=0..7), Slider(25, range=0..25), slider])

# ----
slider_2 = Slider(52267975, range=0..100000000)

# ----
# Set to True
toggle = BooleanToggle(False)

embryo = EmbryoSettings(
    Preview=True,
    SliderDomain=Domain(-10, 10),
    OneToOne=Toggle(True),
    GridX=100,
    GridY=70,
    RemoveDead=False,
    OnlyTerminals=False)
embryo_2 = Embryo(
    Reset=toggle,
    Sliders=Slider(0, range=0..100),
    Components=Slider(5, range=0..10),
    MetricGenes=2,
    TopologyGenes=2,
    FunctionGenes=2,
    Settings=embryo,
    RandomOveride=slider_2)  # -> Iterations, Components
target = Slider(314, range=0..1000)
# Parent input tags an input
# on the main canvas to include
# it in the graph generation
parent_input = ParentInput()
# double click me
galapagos = Galapagos(fitness=abs, gene=slider_2)
subtraction_2 = Subtraction(A=target, B=parent_input)
abs = Absolute(Value=subtraction_2)
pt = ConstructPoint(XCoordinate=expr("x/5", abs), YCoordinate=expr("x/5", abs), ZCoordinate=0)
pt_2 = ConstructPoint(XCoordinate=0, YCoordinate=0, ZCoordinate=0)
ln = Line(StartPoint=pt, EndPoint=pt_2)
